# Grasshopper definition moveMachine.gh (Grasshopper 1.0.7)

number_slider = Slider(0, range=0..100)  # disabled
number_slider_2 = Slider(62, range=0..100)  # disabled
number_slider_3 = Slider(0, range=0..100)  # disabled
number_slider_4 = Slider(67, range=0..100)  # disabled
panel = Panel("y axis")  # disabled
panel_2 = Panel("x axis")  # disabled
list = ValueList({"X": 0, "Y": 1, "Z": 2}, selected="Y")  # disabled
list_2 = ValueList({"X": 0, "Y": 1, "Z": 2}, selected="X")  # disabled
list_3 = ValueList({"X": 0, "Y": 1, "Z": 2, "-X": 3, "-Y": 4, "-Z": 5}, selected="X")
list_4 = ValueList({"X": 0, "Y": 1, "Z": 2, "-X": 3, "-Y": 4, "-Z": 5}, selected="Y")
list_5 = ValueList({"X": 0, "Y": 1, "Z": 2, "-X": 3, "-Y": 4, "-Z": 5}, selected="-X")
list_6 = ValueList({"X": 0, "Y": 1, "Z": 2, "-X": 3, "-Y": 4, "-Z": 5}, selected="Z")
nodeinfo = GhPythonScript(name=panel, type=list, min=number_slider, max=number_slider_4)  # -> out, nodeInfo; inputs type: Int32; disabled
# ---------- nodeinfo: Python ----------
__author__ = "nadya"
__version__ = "2019.03.30"

import rhinoscriptsyntax as rs
from pygestalt import nodes
from pygestalt import interfaces
from pygestalt import machines
from pygestalt import functions
from pygestalt.machines import elements
from pygestalt.machines import kinematics
from pygestalt.machines import state
from pygestalt.utilities import notice
import time
import io
import scriptcontext

class NodeInfo:
    
    def __init__(self, name, axisType, minVal, maxVal):
        self.name = name
        self.axisType = axisType
        self.minVal = minVal
        self.maxVal = maxVal
        pass

nodeInfo = NodeInfo(name, type, min, max)
# ---------- end nodeinfo ----------
nodeinfo_2 = GhPythonScript(name=panel_2, type=list_2, min=number_slider_3, max=number_slider_2)  # -> out, nodeInfo; inputs type: Int32; disabled; same code as nodeinfo
nodeinfo_3 = GhPythonScript(name="x2 axis", type=list_5, min=Slider(0, range=0..100), max=Slider(100, range=0..100))  # -> out, nodeInfo; inputs type: Int32; same code as nodeinfo
nodeinfo_4 = GhPythonScript(name="y axis", type=list_4, min=Slider(0, range=0..100), max=Slider(100, range=0..100))  # -> out, nodeInfo; inputs type: Int32; same code as nodeinfo
nodeinfo_5 = GhPythonScript(name="z axis", type=list_6, min=Slider(0, range=0..100), max=Slider(100, range=0..100))  # -> out, nodeInfo; inputs type: Int32; same code as nodeinfo
nodeinfo_6 = GhPythonScript(name="x1 axis", type=list_3, min=Slider(0, range=0..100), max=Slider(100, range=0..100))  # -> out, nodeInfo; inputs type: Int32; same code as nodeinfo
panel_3 = Panel("sample")  # disabled
toggle = BooleanToggle(True)  # disabled
merge = Merge(Data1=nodeinfo_2.nodeInfo, Data2=nodeinfo.nodeInfo)  # disabled
merge_2 = Merge(Data1=nodeinfo_6.nodeInfo, Data2=nodeinfo_3.nodeInfo, Data3=nodeinfo_4.nodeInfo, Data4=nodeinfo_5.nodeInfo)
number_slider_5 = Slider(9.7, range=0..20)  # disabled
number_slider_6 = Slider(138, range=0..300)  # disabled
number_slider_7 = Slider(88, range=0..100)  # disabled
number_slider_8 = Slider(0, range=0..100)  # disabled
createmachine = GhPythonScript(name=panel_3, enable=toggle, nodeInfos=merge)  # -> out, machineObject; inputs nodeInfos: list; disabled
# ---------- createmachine: Python ----------
# Example machine for testing importing into Rhino
# Nadya for Brian, 2019

#------IMPORTS-------
from pygestalt import nodes
from pygestalt import interfaces
from pygestalt import machines
from pygestalt import functions
from pygestalt.machines import elements
from pygestalt.machines import kinematics
from pygestalt.machines import state
from pygestalt.utilities import notice
import time
import io
import scriptcontext


#------VIRTUAL MACHINE------
# here we describe the kinematics of our machine
# this one uses two direct drive stages with 8mm leadscrews for both X and Y

"""
def initControllers(self):
self.xAxisNode = nodes.networkedGestaltNode('X Axis', self.fabnet, filename = 'module_086_005a.py', persistence = self.persistence)
self.yAxisNode = nodes.networkedGestaltNode('Y Axis', self.fabnet, filename = 'module_086_005a.py', persistence = self.persistence)

self.xyNode = nodes.compoundNode(self.xAxisNode, self.yAxisNode)
"""


class virtualMachine(machines.virtualMachine):

    def initInterfaces(self):
        if self.providedInterface: self.fabnet = self.providedInterface		#providedInterface is defined in the virtualMachine class.
        else: self.fabnet = interfaces.gestaltInterface('FABNET', interfaces.serialInterface(baudRate = 115200, interfaceType = 'ftdi', portName = 'COM6'))
    
    def initControllers(self):
        nodeObjects = []
        """
        for i in range(len(self.nodeInfos)):
            if i == 0:
                self.xAxisNode = nodes.networkedGestaltNode(nodeInfo.name, self.fabnet, filename = 'module_086_005a.py', persistence = self.persistence)
            else:
                self.yAxisNode = nodes.networkedGestaltNode(nodeInfo.name, self.fabnet, filename = 'module_086_005a.py', persistence = self.persistence)
            nodeObjects.append(nodeObject)
        self.nodeObjects = nodeObjects
        """
        self.xAxisNode = nodes.networkedGestaltNode('X Axis', self.fabnet, filename = 'module_086_005a.py', persistence = self.persistence)
        self.yAxisNode = nodes.networkedGestaltNode('Y Axis', self.fabnet, filename = 'module_086_005a.py', persistence = self.persistence)
        
        self.xyNode = nodes.compoundNode(self.xAxisNode, self.yAxisNode)
        
    def initCoordinates(self):
        self.position = state.coordinate(['mm', 'mm'])

    def initKinematics(self):
        #each stage uses a microstepping controller with 4 subdivisions per step. The step angle is 1.8 degrees. The 4 start lead screw has a pitch of 2mm, so one full rotation results in 8mm of travel
        self.xAxis = elements.elementChain.forward([elements.microstep.forward(4), elements.stepper.forward(1.8), elements.leadscrew.forward(8), elements.invert.forward(True)])
        self.yAxis = elements.elementChain.forward([elements.microstep.forward(4), elements.stepper.forward(1.8), elements.leadscrew.forward(8), elements.invert.forward(False)])
        self.stageKinematics = kinematics.direct(2)	#direct drive on all axes

    def initFunctions(self):
        
        #move is the only function we have really implemented for this machine
        self.move = functions.move(virtualMachine = self, virtualNode = self.xyNode, axes = [self.nodeObjects[0], self.nodeObjects[1]], kinematics = self.stageKinematics, machinePosition = self.position,planner = 'null')
        self.jog = functions.jog(self.move)	#an incremental wrapper for the move function
        
        pass

    def initLast(self):
        #self.machineControl.setMotorCurrents(aCurrent = 0.8, bCurrent = 0.8, cCurrent = 0.8)
        #self.xNode.setVelocityRequest(0)	#clear velocity on nodes. Eventually this will be put in the motion planner on initialization to match state.
        pass

    def publish(self):
        #self.publisher.addNodes(self.machineControl)
        pass

    def getPosition(self):
        return {'position':self.position.future()}

    def setPosition(self, position  = [None]):
        self.position.future.set(position)

    def setSpindleSpeed(self, speedFraction):
        #self.machineControl.pwmRequest(speedFraction)
        pass

#----end of virtual machine description------#
if not name:
    name = 'machine'
    

if enable == True:
    machineObject=scriptcontext.sticky.get(name)
    
    if not machineObject.fabnet.interface.Interface.isConnected:
        exit
        
    #------using the virtual machine------
    if not machineObject:
        # The persistence file remembers the node you set.
        # It'll generate the first time you run the
        # nodes. If you are hooking up a new node, delete
        # the previous persistence file. So I guess we need write access?
        
        import os
        os.chdir("c:\dev")
    
        machineObject = virtualMachine(persistenceFile = "{0}.vmp".format(name), nodeInfos=nodeInfos, name=name)
        scriptcontext.sticky[name] = machineObject
# ---------- end createmachine ----------
panel_4 = Panel("y axis")  # disabled
panel_5 = Panel("nadya")  # disabled
toggle_2 = BooleanToggle(True)  # disabled
list_7 = ValueList({"X": 0, "Y": 1, "Z": 2}, selected="Y")  # disabled
toggle_3 = BooleanToggle(True)  # disabled
number_slider_9 = Slider(6, range=0..20)  # disabled
number_slider_10 = Slider(88.9, range=0..300)  # disabled
y_normalized = Slider(4, range=0..140)
node = GhPythonScript(
    machineObject=createmachine.machineObject,
    name=panel_4,
    type=list_7,
    min=number_slider_8,
    max=number_slider_7,
    identify=toggle_2)  # -> out, node; inputs type: Int32, identify: Boolean; disabled
# ---------- node: Python ----------
__author__ = "nadya"
__version__ = "2019.03.30"

import rhinoscriptsyntax as rs
from pygestalt import nodes
from pygestalt import interfaces
from pygestalt import machines
from pygestalt import functions
from pygestalt.machines import elements
from pygestalt.machines import kinematics
from pygestalt.machines import state
from pygestalt.utilities import notice
import time
import io
import scriptcontext

_node = None

if not name:
    name = 'node'

_node = scriptcontext.sticky.get(name)

if identify == True:
    if not _node:
        _node = nodes.networkedGestaltNode(name, machineObject.fabnet, filename = 'module_086_005a.py', persistence = machineObject.persistence)
        _node.axisType = type
        _node.minVal = min
        _node.maxVal = max
        scriptcontext.sticky[name] = _node
    node = _node
else:
    node = None
# ---------- end node ----------
createmachine_2 = GhPythonScript(enable=Toggle(True), name="nadya", nodeInfos=merge_2)  # -> out, machineObject; inputs enable: Boolean, nodeInfos: list
# ---------- createmachine_2: Python ----------
# Example machine for testing importing into Rhino
# Nadya for Brian, 2019

#------IMPORTS-------
from pygestalt import nodes
from pygestalt import interfaces
from pygestalt import machines
from pygestalt import functions
from pygestalt.machines import elements
from pygestalt.machines import kinematics
from pygestalt.machines import state
from pygestalt.utilities import notice
import time
import io
import scriptcontext


#------VIRTUAL MACHINE------
# here we describe the kinematics of our machine
# this one uses two direct drive stages with 8mm leadscrews for both X and Y

class virtualMachine(machines.virtualMachine):

    def initInterfaces(self):
        if self.providedInterface: self.fabnet = self.providedInterface		#providedInterface is defined in the virtualMachine class.
        else: self.fabnet = interfaces.gestaltInterface('FABNET', interfaces.serialInterface(baudRate = 115200, interfaceType = 'ftdi', portName = 'COM6'))

    def initControllers(self):
        nodeInfos = self.nodeInfos
        self.axisNodes=[]
        for nodeInfo in nodeInfos:
            axisNode = nodes.networkedGestaltNode(nodeInfo.name, self.fabnet, filename = 'module_086_005a.py', persistence = self.persistence)
            #axisNode.nodeInfo = nodeInfo
            self.axisNodes.append(axisNode)
        #self.yAxisNode = nodes.networkedGestaltNode('Y Axis', self.fabnet, filename = 'module_086_005a.py', persistence = self.persistence)

        self.xyNode = nodes.compoundNode(*self.axisNodes)

    def initCoordinates(self):
        unit = 'mm'
        units = []
        for i in range(len(self.nodeInfos)):
            units.append(unit)
        self.position = state.coordinate(units)

    def initKinematics(self):
        #each stage uses a microstepping controller with 4 subdivisions per step. The step angle is 1.8 degrees. The 4 start lead screw has a pitch of 2mm, so one full rotation results in 8mm of travel
        self.axises = []
        for nodeInfo in self.nodeInfos:
            invert = True
            if nodeInfo.axisType >= 3:
                invert = False
            axis = elements.elementChain.forward([elements.microstep.forward(4), elements.stepper.forward(1.8), elements.leadscrew.forward(8), elements.invert.forward(invert)])
            self.axises.append(axis)
        #self.xAxis = elements.elementChain.forward([elements.microstep.forward(4), elements.stepper.forward(1.8), elements.leadscrew.forward(8), elements.invert.forward(True)])
        #self.yAxis = elements.elementChain.forward([elements.microstep.forward(4), elements.stepper.forward(1.8), elements.leadscrew.forward(8), elements.invert.forward(False)])
        self.stageKinematics = kinematics.direct(len(self.axises))	#direct drive on all axes

    def initFunctions(self):
        #move is the only function we have really implemented for this machine
        self.move = functions.move(virtualMachine = self, virtualNode = self.xyNode, axes = self.axises, kinematics = self.stageKinematics, machinePosition = self.position,planner = 'null')
        self.jog = functions.jog(self.move)	#an incremental wrapper for the move function
        pass

    def initLast(self):
        #self.machineControl.setMotorCurrents(aCurrent = 0.8, bCurrent = 0.8, cCurrent = 0.8)
        #self.xNode.setVelocityRequest(0)	#clear velocity on nodes. Eventually this will be put in the motion planner on initialization to match state.
        pass

    def publish(self):
        #self.publisher.addNodes(self.machineControl)
        pass

    def getPosition(self):
        return {'position':self.position.future()}

    def setPosition(self, position  = [None]):
        self.position.future.set(position)

    def setSpindleSpeed(self, speedFraction):
        #self.machineControl.pwmRequest(speedFraction)
        pass

#----end of virtual machine description------#
if not name:
    name = 'machine'

if enable == True:
    machineObject=scriptcontext.sticky.get(name)
    #------using the virtual machine------
    if not machineObject:
        # The persistence file remembers the node you set.
        # It'll generate the first time you run the
        # nodes. If you are hooking up a new node, delete
        # the previous persistence file. So I guess we need write access?
        import os
        os.chdir("c:\dev")
    
        machineObject = virtualMachine(persistenceFile = "{0}.vmp".format(name), name=name, nodeInfos=nodeInfos)
        scriptcontext.sticky[name] = machineObject
# ---------- end createmachine_2 ----------
createmachine_3 = GhPythonScript(name=panel_5)  # -> out, machineObject; disabled
# ---------- createmachine_3: Python ----------
# Example machine for testing importing into Rhino
# Nadya for Brian, 2019

#------IMPORTS-------
from pygestalt import nodes
from pygestalt import interfaces
from pygestalt import machines
from pygestalt import functions
from pygestalt.machines import elements
from pygestalt.machines import kinematics
from pygestalt.machines import state
from pygestalt.utilities import notice
import time
import io
import scriptcontext


#------VIRTUAL MACHINE------
# here we describe the kinematics of our machine
# this one uses two direct drive stages with 8mm leadscrews for both X and Y

class virtualMachine(machines.virtualMachine):

	def initInterfaces(self):
		if self.providedInterface: self.fabnet = self.providedInterface		#providedInterface is defined in the virtualMachine class.
		else: self.fabnet = interfaces.gestaltInterface('FABNET', interfaces.serialInterface(baudRate = 115200, interfaceType = 'ftdi', portName = 'COM6'))

	def initControllers(self):
		self.xAxisNode = nodes.networkedGestaltNode('X Axis', self.fabnet, filename = 'module_086_005a.py', persistence = self.persistence)
		self.yAxisNode = nodes.networkedGestaltNode('Y Axis', self.fabnet, filename = 'module_086_005a.py', persistence = self.persistence)

		self.xyNode = nodes.compoundNode(self.xAxisNode, self.yAxisNode)

	def initCoordinates(self):
		self.position = state.coordinate(['mm', 'mm'])

	def initKinematics(self):
        #each stage uses a microstepping controller with 4 subdivisions per step. The step angle is 1.8 degrees. The 4 start lead screw has a pitch of 2mm, so one full rotation results in 8mm of travel
		self.xAxis = elements.elementChain.forward([elements.microstep.forward(4), elements.stepper.forward(1.8), elements.leadscrew.forward(8), elements.invert.forward(True)])
		self.yAxis = elements.elementChain.forward([elements.microstep.forward(4), elements.stepper.forward(1.8), elements.leadscrew.forward(8), elements.invert.forward(False)])
		self.stageKinematics = kinematics.direct(2)	#direct drive on all axes

	def initFunctions(self):
        #move is the only function we have really implemented for this machine
		self.move = functions.move(virtualMachine = self, virtualNode = self.xyNode, axes = [self.xAxis, self.yAxis], kinematics = self.stageKinematics, machinePosition = self.position,planner = 'null')
		self.jog = functions.jog(self.move)	#an incremental wrapper for the move function
		pass

	def initLast(self):
		#self.machineControl.setMotorCurrents(aCurrent = 0.8, bCurrent = 0.8, cCurrent = 0.8)
		#self.xNode.setVelocityRequest(0)	#clear velocity on nodes. Eventually this will be put in the motion planner on initialization to match state.
		pass

	def publish(self):
		#self.publisher.addNodes(self.machineControl)
		pass

	def getPosition(self):
		return {'position':self.position.future()}

	def setPosition(self, position  = [None]):
		self.position.future.set(position)

	def setSpindleSpeed(self, speedFraction):
		#self.machineControl.pwmRequest(speedFraction)
		pass

#----end of virtual machine description------#
if not name:
    name = 'machine'

machineObject=scriptcontext.sticky.get(name)
#------using the virtual machine------
if not machineObject:
	# The persistence file remembers the node you set.
    # It'll generate the first time you run the
	# nodes. If you are hooking up a new node, delete
    # the previous persistence file. So I guess we need write access?
    import os
    os.chdir("c:\dev")

    machineObject = virtualMachine(persistenceFile = "{0}.vmp".format(name), name=name)
    scriptcontext.sticky[name] = machineObject
# ---------- end createmachine_3 ----------
panel_6 = Panel(createmachine.out)  # disabled
pt = ConstructPoint(XCoordinate=number_slider_6, YCoordinate=number_slider_5, ZCoordinate=0)  # disabled
crv = Curve([<curve referenced from the Rhino model> x14])
toggle_4 = BooleanToggle(True)  # disabled
toggle_5 = BooleanToggle(False)  # disabled
pt_2 = ConstructPoint(XCoordinate=number_slider_10, YCoordinate=number_slider_9, ZCoordinate=0)  # disabled
number_slider_11 = Slider(15, range=0..100)
divide = DivideCurve(Curve=crv, Count=Slider(24, range=0..100), Kinks=False)  # -> Points, Tangents, Parameters
merge_3 = Merge(Data1=nodeinfo_2.nodeInfo, Data2=node.node)  # -> flatten(Result); disabled
panel_7 = Panel(node.node)  # disabled
pdecon = Deconstruct(Point=divide.Points)  # -> XComponent, YComponent, ZComponent
addition = Addition(A=y_normalized, B="-372")
movemachine = GhPythonScript(run=toggle_4, machineObject=createmachine.machineObject, pts=pt)  # -> out, a; inputs run: Boolean, pts: list of Point3d; disabled
# ---------- movemachine: Python ----------
import time
# This is for how fast the motors will move
machineObject.xyNode.setVelocityRequest(8)

# Some random moves to test, in the future maybe these can come from GH!
#moves = [[10,10],[20,20],[10,10],[0,0]]

moves = []
for pt in pts:
    move = [pt.X, pt.Y]
    moves.append(move)

# Move!
for move in moves:
    machineObject.move(move, 0)
    status = machineObject.xAxisNode.spinStatusRequest()
    # This checks to see if the move is done. Because the nodes in the
    # compoundnode are synced, you only need to check one. We are checking X
    while status['stepsRemaining'] > 0:
        time.sleep(0.001)
        status = machineObject.xAxisNode.spinStatusRequest()
# machineObject.fabnet.disconnect()
# ---------- end movemachine ----------
movemachine_2 = GhPythonScript(run=toggle_5, machineObject=createmachine_3.machineObject, pts=pt_2)  # -> out, a; inputs run: Boolean, pts: list of Point3d; disabled; same code as movemachine
pt_3 = ConstructPoint(XCoordinate=Slider(-99, range=-200..200), YCoordinate=addition, ZCoordinate=Slider(10, range=0..16))
pt_4 = ConstructPoint(XCoordinate=pdecon.XComponent, YCoordinate=pdecon.YComponent, ZCoordinate=pdecon.ZComponent)
item = ListItem(List=pt_4, Index=Slider(0, range=0..10), Wrap=True)
movemachine_3 = GhPythonScript(run=toggle_4, machineObject=createmachine.machineObject, nodeObjects=merge_3, pts=pt)  # -> out, a; inputs run: Boolean, nodeObjects: list, pts: list of Point3d; disabled
# ---------- movemachine_3: Python ----------
from pygestalt import nodes
from pygestalt import interfaces
from pygestalt import machines
from pygestalt import functions
from pygestalt.machines import elements
from pygestalt.machines import kinematics
from pygestalt.machines import state
from pygestalt.utilities import notice
import time
import io
import scriptcontext

# Some random moves to test, in the future maybe these can come from GH!
#moves = [[10,10],[20,20],[10,10],[0,0]]


machineObject.xyNode = nodes.compoundNode(nodeObjects[0], nodeObjects[1])



machineObject.move = functions.move(virtualMachine = machineObject, virtualNode = machineObject.xyNode, axes = nodes, kinematics = machineObject.stageKinematics, machinePosition = machineObject.position,planner = 'null')
machineObject.jog = functions.jog(machineObject.move)	#an incremental wrapper for the move function


# This is for how fast the motors will move
machineObject.xyNode.setVelocityRequest(8)

moves = []
for pt in pts:
    move = [pt.X, pt.Y]
    moves.append(move)



# Move!
for move in moves:
    machineObject.move(move, 0)
    status = machineObject.xAxisNode.spinStatusRequest()
    # This checks to see if the move is done. Because the nodes in the
    # compoundnode are synced, you only need to check one. We are checking X
    while status['stepsRemaining'] > 0:
        time.sleep(0.001)
        status = machineObject.xAxisNode.spinStatusRequest()
# machineObject.fabnet.disconnect()
# ---------- end movemachine_3 ----------
setorigin = GhPythonScript(run=Toggle(True), machineObject=createmachine_2.machineObject, pt=pt_3)  # -> out, origin; inputs run: Boolean, pt: Point3d
# ---------- setorigin: Python ----------
import time
# This is for how fast the motors will move
machineObject.xyNode.setVelocityRequest(8)

# Some random moves to test, in the future maybe these can come from GH!
#moves = [[10,10],[20,20],[10,10],[0,0]]

"""
types = []
minVals = []
maxVals = []
for axisNode in machineObject.axisNodes:
    nodeInfo = axisNode.nodeInfo
    types.append(nodeInfo.axisType)
    minVals.append(nodeInfo.minVal)
    maxVals.append(nodeInfo.maxVal)
"""
moves = []
move=[pt.X, pt.X, pt.Y, pt.Z]
"""
    for i in range(len(types)):
        
        if type == 0:
            val = min(max(minVals[i], pt.X), maxVals[i])
            move.append(val)
        elif type == 1:
            val = min(max(minVals[i], pt.Y), maxVals[i])
            move.append(val)
        elif type == 2:
            val = min(max(minVals[i], pt.Z), maxVals[i])
            move.append(val)
            """
moves.append(move)

# Move!
if run == True:
    for move in moves:
        machineObject.move(move, 0)
        status = machineObject.axisNodes[0].spinStatusRequest()
        # This checks to see if the move is done. Because the nodes in the
        # compoundnode are synced, you only need to check one. We are checking X
        while status['stepsRemaining'] > 0:
            time.sleep(0.001)
            status = machineObject.axisNodes[0].spinStatusRequest()
    # machineObject.fabnet.disconnect()


origin = pt
# ---------- end setorigin ----------
movemachine_4 = GhPythonScript(run=Button(), machineObject=createmachine_2.machineObject, pts=flatten(pt_4), origin=setorigin.origin)  # -> out, a; inputs run: Boolean, pts: list of Point3d, origin: Point3d
# ---------- movemachine_4: Python ----------
import time
# This is for how fast the motors will move
machineObject.xyNode.setVelocityRequest(8)

# Some random moves to test, in the future maybe these can come from GH!
#moves = [[10,10],[20,20],[10,10],[0,0]]

"""
types = []
minVals = []
maxVals = []
for axisNode in machineObject.axisNodes:
    nodeInfo = axisNode.nodeInfo
    types.append(nodeInfo.axisType)
    minVals.append(nodeInfo.minVal)
    maxVals.append(nodeInfo.maxVal)
"""
moves = []
for pt in pts:
    move=[pt.X + origin.X, pt.X + origin.X, pt.Y + origin.Y, pt.Z + origin.Z]
    """
    for i in range(len(types)):
        
        if type == 0:
            val = min(max(minVals[i], pt.X), maxVals[i])
            move.append(val)
        elif type == 1:
            val = min(max(minVals[i], pt.Y), maxVals[i])
            move.append(val)
        elif type == 2:
            val = min(max(minVals[i], pt.Z), maxVals[i])
            move.append(val)
            """
    moves.append(move)

# Move!
if run == True:
    for move in moves:
        machineObject.move(move, 0)
        status = machineObject.axisNodes[0].spinStatusRequest()
        # This checks to see if the move is done. Because the nodes in the
        # compoundnode are synced, you only need to check one. We are checking X
        while status['stepsRemaining'] > 0:
            time.sleep(0.001)
            status = machineObject.axisNodes[0].spinStatusRequest()
    # machineObject.fabnet.disconnect()
# ---------- end movemachine_4 ----------
panel_8 = Panel(movemachine.out)  # disabled
panel_9 = Panel(movemachine_4.out)
