# Grasshopper definition path planning.gh (Grasshopper 1.0.7)

crv = Curve([<curve referenced from the Rhino model> x17])
Z = UnitZ(Factor=1)
suirify = Suirify(crv)
topoly = CurveToPolyline(Curve=suirify, ToleranceDistance=Slider(0.014, range=0..3), ToleranceAngle=0)  # -> Polyline, Segments
number_slider = Slider(0, range=0..3)
multiplication = Multiplication(A=Slider(2.7, range=-10..10), B=Z)
shift = ShiftList(List=topoly.Polyline, Shift=1, Wrap=False)
shift_2 = ShiftList(List=topoly.Polyline, Shift=-1, Wrap=False)
end = EndPoints(Curve=shift_2)  # -> Start, End
end_2 = EndPoints(Curve=shift)  # -> Start, End
shift_3 = ShiftList(List=end_2.End, Shift=1, Wrap=True)
item = ListItem(List=end.Start, Index=0, Wrap=True)
graft = GraftTree(Tree=suirify, IncludeEmptyLists=True, IncludeNullItems=True)
move = Move(Geometry=end.End, Motion=multiplication)  # -> Geometry, Transform
move_2 = Move(Geometry=end_2.Start, Motion=multiplication)  # -> Geometry, Transform
move_3 = Move(Geometry=shift_3, Motion=multiplication)  # -> Geometry, Transform
move_4 = Move(Geometry=item, Motion=multiplication)  # -> Geometry, Transform
panel = Panel(topoly.Polyline)
ln = Line(StartPoint=move_4.Geometry, EndPoint=item)
ln_2 = Line(StartPoint=shift_3, EndPoint=move_3.Geometry)
ln_3 = Line(StartPoint=move_2.Geometry, EndPoint=end_2.Start)
ln_4 = Line(StartPoint=end.End, EndPoint=move.Geometry)
ln_5 = Line(StartPoint=move.Geometry, EndPoint=move_2.Geometry)
join = JoinCurves(Curves=[ln_4, ln_5, ln_3], Preserve=False)
weave = Weave(Pattern=[0, 1], Stream0=topoly.Polyline, Stream1=join, NullGaps=False)
merge = Merge(Data1=ln, Data2=weave, Data3=ln_2)
